# Grasshopper definition 02_Advanced.gh (Grasshopper 0.9.76)
# plug-ins: Spectacles.GrasshopperExporter, Colibri

Y = Slider(1, range=1..10)
X = Slider(1, range=1..10)
box = DomainBox(Base=PlaneXY(0, 0, 0), X=X, Y=Y, Z=Domain(0, 0.25))

# ----
# 1) Division setting
# In this case:
# Evenly take 6 values from "X" parameter;
# Evenly take 3 values from "Y" parameter;
panel = Panel("""6
3""")
sel = IterationSelection(Divisions=panel)

# ----
# 2) Domain setting
# In this case:
# Run from #0 to #20 iteration
# Accepts multi-domains
panel_2 = Panel("0")
dom = ConstructDomain(DomainStart=panel_2, DomainEnd="20")
# "Fly Test" will ignore Selection settings,
# and randomly pick 3 Iterations
sel_2 = IterationSelection(Domains=dom)
panel_3 = Panel(dom)

# ----
# 3) Combo setting
# In this case:
# Evenly take 5 values from "X" parameter;
# Evenly take 5 values from "Y" parameter;
# 
# Now we have 5x5 = 25 Iterations in total;
# Then run from #0 to #20 iteration from above 25
panel_4 = Panel("""5
5""")
dom_2 = ConstructDomain(DomainStart="0", DomainEnd="20")
sel_3 = IterationSelection(Divisions=panel_4, Domains=dom_2)
panel_5 = Panel(dom_2)

volume = Volume(Geometry=box)  # -> Volume, Centroid

wires = BrepWireframe(Brep=box, Density=-1)
mesh = Mesh(box)
mcol = MeshColours(Mesh=mesh, Colours=ColourSwatch(SwatchColor=RGB(255, 0, 0)))
spectacles_meshcoloredvertices = Spectacles_MeshColoredVertices(Mesh=mcol)
spectacles_line = Spectacles_Line(Line=wires)
sceneobjects = Spectacles_SceneObjects(Elements=flatten([spectacles_meshcoloredvertices, spectacles_line]))

panel_6 = Panel("""Top
Perspective""")
img_setting = ImageSetting(ImageSaveAsName="defaultName", RhinoViewNames=panel_6, Width="600", Height="600")

parameters = ColibriParameters(V=flatten(volume.Volume))
# Right click the Iterator for
# "Fly Test"
iterator = ColibriFlyIDIterator(X=X, Y=Y, Selection=sel, ignoreAllWarningMsg=False, RemoteFly=False)  # -> X, Y, Value_N, Genome
# Right click the Aggregator for
# override mode setting
# 1) Clean the folder,
#      and run all Iterations
# 
# 2) Do not clean the folder,
#      run all Iterations,
#      and append data to the end of CSV file
# 
# 3) Do not clean the folder,
#      run the Iterations if not exist in current CSV,
#      and append new data to the end of CSV file.
# 
# 4) Ask me everytime if the folder is not empty
toggle = BooleanToggle(False)
aggregator = ColibriAggregator(
    Folder="c:\Colibri",
    IterationGenomeID=iterator.Genome,
    IterationPhenomeResults=parameters,
    ImgSetting=img_setting,
    _3DObjects=flatten(sceneobjects),
    Write=toggle,
    recordingMode=3)
recorded_data = Panel(aggregator)
