# Grasshopper definition BoxTest.gh (Grasshopper 0.9.76)
# plug-ins: Colibri, CORE.Grasshopper.Spectacles

length = Slider(10, range=1..10)
width = Slider(10, range=1..10)
height = Slider(10, range=1..10)
panel = Panel("""3
4
2""")
box = CenterBox(Base=PlaneXY(0, 0, 0), X=length, Y=width, Z=height)
brep = Brep(box)
iterator = Iterator(Sliders=[length, width, height], Steps=panel, Fly=Button())
toggle = BooleanToggle(False)
volume = Volume(Geometry=brep)  # -> Volume, Centroid
panel_2 = Panel(iterator)
imageparameter = ImageParameter(WidthInput="400", HeightInput="400")
formatoutputs = FormatOutputs(OutputNames="Volume", OutputValues=volume.Volume)
material = CreateMaterial(
    Diffuse=ColourSwatch(SwatchColor=RGB(255, 0, 140)),
    Specular=RGB(255, 255, 255),
    Emission=RGB(0, 0, 0),
    Transparency=Slider(0.85, range=0..1),
    Shine=0)
preview = CustomPreview(Geometry=brep, Shader=material)
swatch = ColourSwatch(SwatchColor=RGB(255, 0, 140))
toggle_2 = BooleanToggle(False)
spectacles_meshlambertmaterial = Spectacles_MeshLambertMaterial(Color=swatch, AmbientColor=swatch, EmissiveColor=RGB(0, 0, 0), Object_Opacity=1, SmoothEdges=True)
aggregator = Aggregator(
    FolderPath="C:\Users\bhowes\Desktop\Colibri\Box_1239",
    InputsDataSet=iterator,
    OutputsDataSet=formatoutputs,
    ImageParams=imageparameter,
    WriteFile=toggle_2)  # -> WriteInData, SpectaclesFileName
spectacles_mesh = Spectacles_Mesh(Mesh=brep, MeshMaterial=spectacles_meshlambertmaterial)
spectacles_scenecompiler = Spectacles_SceneCompiler(Write=toggle_2, FilePath=aggregator.SpectaclesFileName, Elements=flatten(spectacles_mesh))
