# Grasshopper definition GalapagosTest.gh (Grasshopper 0.9.76)
# plug-ins: Colibri

chain_length = Slider(286.13, range=10..1000)
crv = Curve(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)
pt = Point([Point(-49.94976008, 0, -126.0947265), Point(-93.82921712, 0, -50.53088579), Point(-19.38183205, 0, -90.11037929)])
end = EndPoints(Curve=crv)  # -> Start, End
Z = UnitZ(Factor=1)
rev = Reverse(Vector=Z)
cat = Catenary(PointA=end.Start, PointB=end.End, Length=chain_length, Gravity=rev)
colibri_inputs = ColibriInputs(Sliders=chain_length)
crv_cp = CurveClosestPoint(Point=pt, Curve=cat)  # -> Point, Parameter, Distance
image_parameters = ImageParameters(Width=400, Height=400)
ma = MassAddition(Input=crv_cp.Distance)  # -> Result, PartialResults
num = Number(ma.Result)
colibri_outputs = ColibriOutputs(Names="Cumulative Distance", Values=num)
aggregator = Aggregator(
    Folder="C:\Users\bhowes\Desktop\Colibri\GalapagosChain_20161220",
    Inputs=colibri_inputs,
    Outputs=colibri_outputs,
    ImgParams=image_parameters,
    Write=Toggle(True))
galapagos = Galapagos(fitness=ma, gene=chain_length)
