# Grasshopper definition Iterator2Testing.gh (Grasshopper 0.9.76)
# plug-ins: Colibri

wwr = Slider(0.484, range=0..1)
ddd = Slider(10, range=0..10)
windows = Panel("dddg")
listdd = ValueList({"One": 1, "Two": 2, "Three": 2² - 1, "Four": Sqrt(16)}, selected="One")
rename = Slider(0.25, range=0..1)
iterator = IteratorFly(ValueList_Listdd=listdd, Unsupported=Toggle(False), Fly=Toggle(False))  # -> Listdd, Unsupported, C, Inputs
panel = Panel(iterator.Listdd)
