# Grasshopper definition Workflow Sketch.gh (Grasshopper 0.9.76)
# plug-ins: Colibri, CORE.Grasshopper.Spectacles

depth = Slider(0.162, range=0..1)
height = Slider(0.344, range=0..1)
spectacles_meshbasicmaterial = Spectacles_MeshBasicMaterial(Object_Opacity=1)
panel = Panel("""15
10""")
c_script = CSharpScript(X=depth, Y=height)  # -> Out, A
panel_2 = Panel("""volume
area""")
spectacles_mesh = Spectacles_Mesh(Mesh=c_script.A, MeshMaterial=spectacles_meshbasicmaterial)

# ---- group: ITERATOR
iterator = Iterator(Sliders=[depth, height], Steps=panel, Fly=Button())

# ---- group: FormatOutputs
c_script_2 = CSharpScript(OutputNames=panel_2, OutputValues=c_script.A)

# ---- group: Image Parameters
c_script_3 = CSharpScript()

# ---- group: Aggregator
c_script_4 = CSharpScript(
    Directory="C:\Users\bhowes\Desktop\Dummy",
    Inputs=iterator,
    Outputs=c_script_2,
    ImageParams=c_script_3,
    SpectaclesElements=spectacles_mesh,
    WriteFile=Toggle(False))  # -> Out, A
