# Grasshopper definition iterator testing.gh (Grasshopper 0.9.76)
# plug-ins: Colibri

iterator = Iterator(
    Sliders=[Slider(0, range=0..10), Slider(0, range=0..10), Slider(0, range=0..10)],
    Steps=Slider(0, range=0..10),
    Fly=Button())
panel = Panel(iterator)
