# Grasshopper definition uploader.gh (Grasshopper 0.9.76)
# plug-ins: Colibri

panel = Panel("C:\Users\Mingbo\Documents\GitHub\Colibri.Grasshopper\docs\TestWorkflows\Testpath")
uploader = Uploader(FolderPath=panel, Upload=Toggle(False))
c_script = CSharpScript()  # -> out, A
# ---------- c_script: C# ----------
    
    var stream =new FileStream(@"C:\ladybug\client_secret.json", FileMode.Open, FileAccess.Read);
    A = stream;
# ---------- end c_script ----------
panel_2 = Panel(c_script.A)
panel_3 = Panel(c_script.out)
